% Simulink data dictionary amcfoc.sldd
% references newBoard.sldd

numberOfActuators = 2
Actuators = Simulink.Parameter([], DataType="Bus: ActuatorConfiguration")

InitConfParams = Simulink.Parameter([struct(
  thresholds=struct(
    jntVelMax=single(40000),
    motorNominalCurrents=single(0.35),
    motorPeakCurrents=single(0.7),
    motorOverloadCurrents=single(1),
    motorPwmLimit=uint32(0),
    motorCriticalTemperature=single(0)),
  pids=struct(
    currentPID=struct(
      type=ControlModes.Current,
      OutMax=single(0),
      OutMin=single(0),
      P=single(2),
      I=single(500),
      D=single(0),
      N=single(10),
      I0=single(0),
      D0=single(0),
      shift_factor=uint8(0)),
    velocityPID=struct(
      type=ControlModes.Velocity,
      OutMax=single(0),
      OutMin=single(0),
      P=single(-3.0e-5),
      I=single(-3.0e-5),
      D=single(0),
      N=single(10),
      I0=single(0),
      D0=single(0),
      shift_factor=uint8(0)),
    positionPID=struct(
      type=ControlModes.Position,
      OutMax=single(0),
      OutMin=single(0),
      P=single(0),
      I=single(0),
      D=single(0),
      N=single(0),
      I0=single(0),
      D0=single(0),
      shift_factor=uint8(0))),
  motor=struct(
    has_hall_sens=true,
    has_quadrature_encoder=false,
    has_speed_quadrature_encoder=false,
    has_torque_sens=false,
    use_index=false,
    enable_verbosity=false,
    rotor_encoder_resolution=int16(0),
    rotor_index_offset=int16(0),
    encoder_tolerance=uint8(0),
    pole_pairs=uint8(7),
    Kbemf=single(0),
    Rphase=single(0),
    Imin=single(0),
    Imax=single(0),
    Vcc=single(24),
    Vmax=single(44),
    resistance=single(25.9),
    inductance=single(271),
    thermal_resistance=single(16),
    thermal_time_constant=single(797.5))), struct(
  thresholds=struct(
    jntVelMax=single(40000),
    motorNominalCurrents=single(0.35),
    motorPeakCurrents=single(0.7),
    motorOverloadCurrents=single(2),
    motorPwmLimit=uint32(0),
    motorCriticalTemperature=single(0)),
  pids=struct(
    currentPID=struct(
      type=ControlModes.Current,
      OutMax=single(0),
      OutMin=single(0),
      P=single(2),
      I=single(500),
      D=single(0),
      N=single(10),
      I0=single(0),
      D0=single(0),
      shift_factor=uint8(0)),
    velocityPID=struct(
      type=ControlModes.Velocity,
      OutMax=single(0),
      OutMin=single(0),
      P=single(-3.0e-5),
      I=single(-3.0e-5),
      D=single(0),
      N=single(10),
      I0=single(0),
      D0=single(0),
      shift_factor=uint8(0)),
    positionPID=struct(
      type=ControlModes.Position,
      OutMax=single(0),
      OutMin=single(0),
      P=single(0),
      I=single(0),
      D=single(0),
      N=single(0),
      I0=single(0),
      D0=single(0),
      shift_factor=uint8(0))),
  motor=struct(
    has_hall_sens=true,
    has_quadrature_encoder=false,
    has_speed_quadrature_encoder=false,
    has_torque_sens=false,
    use_index=false,
    enable_verbosity=false,
    rotor_encoder_resolution=int16(0),
    rotor_index_offset=int16(0),
    encoder_tolerance=uint8(0),
    pole_pairs=uint8(7),
    Kbemf=single(0),
    Rphase=single(0),
    Imin=single(0),
    Imax=single(0),
    Vcc=single(24),
    Vmax=single(44),
    resistance=single(25.9),
    inductance=single(271),
    thermal_resistance=single(16),
    thermal_time_constant=single(797.5)))], StorageClass="ExportedGlobal", Alias="InitConfParams", DataType="Bus: ActuatorConfiguration")